# Grasshopper definition OpenPyStruct_Beam_Optimize.ghx (Grasshopper 1.0.8)
# plug-ins: OpenPyStruct

pt = ConstructPoint(XCoordinate=0, YCoordinate=0, ZCoordinate=0)
pt_2 = ConstructPoint(XCoordinate=10, YCoordinate=0, ZCoordinate=0)
ln = Line(StartPoint=pt, EndPoint=pt_2)
pt_3 = ConstructPoint(XCoordinate=5, YCoordinate=0, ZCoordinate=0)
vec = VectorXYZ(XComponent=0, YComponent=0, ZComponent=-50000)  # -> Vector, Length
beam = BeamModel(Axis=ln, Elements=100, Scheme="Simply supported", Pins=pt, Rollers=pt_2)  # -> Model, Nodes, Supports, Info
loads = LoadCase(Model=beam.Model, Points=pt_3, Forces=vec.Vector, UDL=-5000, UDLOn="Horizontal members", Name="LC1")  # -> LoadCase, Arrows, Info
optsettings = OptimizerSettings(Preset="Beam (BeamOpt)", Combination="Sum of cases")
engine = Engine(
    Image="openpystruct",
    CPUs=0,
    GPU=False,
    Platform="native",
    FEBackend="auto",
    Timeout=0,
    Mode="container",
    Device="auto",
    Check=False,
    Build=False)  # -> Engine, Status
material = Material(Preset="Steel (scripts, 200 GPa)", A=0.01, I0=0.5, K=0.03)
optimize = Optimize(Model=beam.Model, Loads=loads.LoadCase, Material=material, Settings=optsettings, Engine=engine.Engine, Run=False)  # -> Result, Log, Folder, I, Summary
vizresult = VisualizeResult(Result=optimize.Result, Case=0, Width=0.3, DiagramScale=0, DeflectionScale=0, ColourBy="Moment of inertia")  # -> Sections, Colors, Depths, Moment, Shear, Deflected, Range, Scales
deresult = DeconstructResult(Result=optimize.Result, Case=0, Units="N, m")  # -> I, Axial, ShearStart, ShearEnd, MomentStart, MomentEnd, Displacements, Rotations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
