# Grasshopper definition OpenPyStruct_Frame_Optimize.ghx (Grasshopper 1.0.8)
# plug-ins: OpenPyStruct

pt = ConstructPoint(XCoordinate=0, YCoordinate=0, ZCoordinate=0)
pt_2 = ConstructPoint(XCoordinate=0, YCoordinate=0, ZCoordinate=4)
pt_3 = ConstructPoint(XCoordinate=8, YCoordinate=0, ZCoordinate=4)
pt_4 = ConstructPoint(XCoordinate=8, YCoordinate=0, ZCoordinate=0)
ln = Line(StartPoint=pt, EndPoint=pt_2)
ln_2 = Line(StartPoint=pt_2, EndPoint=pt_3)
ln_3 = Line(StartPoint=pt_3, EndPoint=pt_4)
vec = VectorXYZ(XComponent=20000, YComponent=0, ZComponent=0)  # -> Vector, Length
merge = Merge(Data1=ln, Data2=ln_2)
merge_2 = Merge(Data1=merge, Data2=ln_3)
merge_3 = Merge(Data1=pt, Data2=pt_4)
frame = FrameModel(Members=merge_2, Fixed=merge_3, Tolerance=0.001, Base="Fixed")  # -> Model, Nodes, Supports, Elements, Kinds, Info
loads = LoadCase(Model=frame.Model, Points=pt_2, Forces=vec.Vector, UDL=-5000, UDLOn="Horizontal members", Name="LC1")  # -> LoadCase, Arrows, Info
optsettings = OptimizerSettings(Preset="Beam (BeamOpt)", Combination="Sum of cases")
engine = Engine(
    Image="openpystruct",
    CPUs=0,
    GPU=False,
    Platform="native",
    FEBackend="auto",
    Timeout=0,
    Mode="container",
    Device="auto",
    Check=False,
    Build=False)  # -> Engine, Status
material = Material(Preset="Steel (scripts, 200 GPa)", A=0.01, I0=0.5, K=0.03)
optimize = Optimize(Model=frame.Model, Loads=loads.LoadCase, Material=material, Settings=optsettings, Engine=engine.Engine, Run=False)  # -> Result, Log, Folder, I, Summary
vizresult = VisualizeResult(Result=optimize.Result, Case=0, Width=0.3, DiagramScale=0, DeflectionScale=0, ColourBy="Moment of inertia")  # -> Sections, Colors, Depths, Moment, Shear, Deflected, Range, Scales
